# Requirement set untitled (R2019b)

## 1 [#1] Can sense Ain when PVARP idle (Informational)
DDD pacemaker requires A-V sychrony, when not in PVARP period, must be able to sense Ain.

## 2 [#2] Back to Idle after sensed Ain
DDD pacemaker requires A-V sychrony, when not in PVARP period, must be able to sense Ain.

## 3 [#3] State Sensed Ain
When Atrial signal be sent during PVARP_idle state, transite to this state.

## 4 [#4] PVARP subsystem
DDD pacemaker requires not make Atrial and Ventricular events too close to each other. So after a V event, must wait a interval, during which cannot sense new Atrial signals.

## 5 [#5] State PVARP block
In this state, All Atrial signal should be ignored.

## 6 [#8] When VS or VP sensed, got blocked
During Idle state, when VS or VP were sensed, PVARP got blocked, and ignore all A signals.

## 7 [#9] Timer discount
Discount timer until TPVARP_cur <=0, then transfer to idle.

## 8 [#10] Ignore Ain when PVARP blocked
In order not to make Atrial and Ventricular events too close to each other, Atrial signal must be ignored when PVARP blocked.

## 9 [#11] State PVARP ARgot
In order not to make Atrial and Ventricular events too close to each other, Atrial signal must be ignored when PVARP blocked.

## 10 [#12] Back to block after sensed Ain
After got an AR, go back to blocked state.

## 11 [#13] State VRP idle
The inital state of VRP, when sensed VS or VP was generated, transfers to block state.

## 12 [#14] VRP subsystem
A DDD pacemaker should never give VP during VRP, for which may cause ventricular fibrillation.

## 13 [#15] State VRP VSgot
when sensed a VS signal, transfer from this state to block state.

## 14 [#16] Blocked when VP was sent
After a VP was sent, start the timer of VRP subsystem, and got blocked.

## 15 [#17] Transfer to VSgot when Vin sensed
After a Vin signal sensed, transfer to VSgot state.

## 16 [#18] State VRP block
After a ventricular event, go to this state until VRP timer discount to 0.

## 17 [#19] Timer discount
Discount timer until TVRP_cur <=0, then transfer to idle.

## 18 [#20] Transfer to idle when VRP ends
When PVARP period ends, must go back to idle state.

## 19 [#21] LRI subsystem
A DDD pacemaker should maintain the heart rate no slower than the minimum heart rate.

## 20 [#22] Back to idle after VP
After a VP signal sensed, LRI should be reset (back to idle state)

## 21 [#23] State LRI VPgot
During LRI block state, when a VP signal sensed, transfer to this state.

## 22 [#24] State LRI idle
The initial state of LRI subsystem, should be able to be blocked when Atrial signal sensed.

## 23 [#25] Timer discount
Discount timer until TLRI_cur <= TLRI_def, then transfer to blocked state.

## 24 [#26] Timer reset
When VS or VP sensed, reset LRI timer.

## 25 [#27] Got blocked when Ain sensed
During LRI idle state, when Ain was sensed, transfer to LRI block state.

## 26 [#28] Sent AP and got blocked
When timer discount to TLRI_def, sends AP and got blocked.

## 27 [#29] Back to Idle when V signal sensed.
When Vin was sensed or VP was sent, reset it to idle state.

## 28 [#30] State LRI block
During this state, pacemaker should wait until Ventricular events occur.

## 29 [#31] Timer discount
Discount timer until TLRI_cur <= 0, then transfer to VPgot state and send a VP to maintain lower heart rate.

## 30 [#32] Reset AP
If Atrial Pace sent, reset it to false.

## 31 [#33] Give VP when LRI timer less than 0
A DDD pacemaker should give VP when LRI timer less than 0, to maintain heartrate >= 60bpm.

## 32 [#34] Init transfer LRI
Initialize of LRI.

## 33 [#35] Init transfer VRP
Initialize of VRP.

## 34 [#36] Init transfer PVARP
Initialize of PVARP.

## 35 [#37] Init transfer AVI
Initialize of AVI.

## 36 [#38] Init transfer URI
Initialize of URI.

## 37 [#39] AVI subsystem
A DDD pacemaker should consider A-V synchrony, which is, after an atrial event, if no ventricular events happen during AVI, then send VP.

## 38 [#40] State AVI idle
Idle state of AVI, should be able to get blocked when Atrial events happen.

## 39 [#41] State AVI block
when atrial event sensed, got blocked and start a timer. If no ventricular events happen during this interval, gives a VP.

## 40 [#42] State AVI VPgot
Send VP when timer dicount to 0.

## 41 [#43] Got blocked at atrial event
Got blocked at atrial event, and wait for ventricular events happen.

## 42 [#44] back to idle at ventricular event
back to idle at ventricular event, and wait for an atrial event happen.

## 43 [#45] Timer discount
Discount timer until TAVI_cur <= 0, then transfer to VPgot state and send a VP to maintain normal heart rate.

## 44 [#46] Reset VP
After giving a VP, reset VP to false

## 45 [#47] Send VP if no ventricular events happen
Send VP if no ventricular events happen, to maintain normal heart rate.

## 46 [#48] URI subsystem
A DDD pacemaker should maintain the heart rate no faster than the maximum heart rate.

## 47 [#49] Reset VS
After sensing a Vin signal, reset VS to false.

## 48 [#50] State URI idle
The initial state of URI, when VS or VP sensed, should be able to got blocked.

## 49 [#51] State URI blocked
Blocked URI when Ventriculer events happen, ensure not to send VP during this period.

## 50 [#52] Timer discount
Discount timer until TURI_cur <= 0, then transfer to idle state.

## 51 [#53] Go back to idle when timer less than 0
When URI period ends, go back to Idle state.

## 52 [#54] Blocked when Ventricular signal sensed
Pacemaker should get blocked when Ventricular signal sensed.

## 53 [#55] Reset timer at VS or VP
When a ventricular event sensed(VS or VP), reset the timer.

## 54 [#6] State PVARP Idle
Initial state of PVARP, must be able to sense Atrial signal and Ventricular signal and do transitions.

## 55 [#7] Back to idle when PVARP ends
When PVARP period ends, must go back to idle state.